# Grasshopper definition generate data.gh (Grasshopper 1.0.7)

res_mm = Slider(4, range=0..10)
select_dir = FilePath("C:\Users\sharan\Dropbox\sharan\HUJI\dynamic style\generated test data\")
crv = Curve([<curve referenced from the Rhino model> x5000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])
# connection line on bowl edge
py_data_generator = GhPythonScript(curves=crv, res=res_mm, filename="testdata banana", dir=select_dir)  # -> out, goodCrv; inputs curves: list
# ---------- py_data_generator: Python ----------
"""
this component takes a curve , divides it to points res mm apart and generates a 
GCODE for mach3 machine 
inputs are in mm
output gcode file is in mm

    Inputs:
        header : lines from mach3 nc file
        end     :  lines from mach3 nc file
        crv:         curve to mill
        res:    distance between points on the curve 
        filename: 
        dir:  directory to place the file
    Output:
        a: The a output variable """

__author__ = "sharanism"
__version__ = "2019.08.08"

import rhinoscriptsyntax as rs
import time;


s=''
header="time\tx\ty\tpressure\ttiltX\ttiltY\tazimuth\tsidePressure\trotation"
s+=header+'\n'
dt=0.01732577
t=0
goodCrv=[]
for crv in curves:
    len=rs.CurveLength(crv)
    if(len<10):
        continue
    if(len>50): #split the curve
        params=rs.DivideCurve(crv,int(len/50),create_points=False,return_points =False)
        if(not params):
            print("in if statement")
            goodCrv.append(crv)
            continue
        subcrv=rs.SplitCurve(crv,params,delete_input=True)
        goodCrv=goodCrv+subcrv
        continue
    if(not rs.IsCurveClosed(crv)):
        goodCrv.append(crv) #i.e crv 50>len>10 and not a vectorization artifact
    
    

for crv in goodCrv:
    for pt in rs.DivideCurveLength(crv,res):
        s+=(str(t)+'\t'+str(int(pt[0]))+'\t'+str(int(pt[1]))+'\t0\t0\t0\t0\t0\t0'+ '\n')  
        t+=dt
    pt=rs.CurveEndPoint(crv)
    s+=(str(t)+'\t'+str(int(pt[0]))+'\t'+str(int(pt[1]))+'\t0\t0\t0\t0\t0\t0'+ '\n') 
    s+="Pause\n"
    t+=1

filename=dir+filename+'.txt'
f = open(filename, "w")
f.write(s)
f.close()
# ---------- end py_data_generator ----------
